# Grasshopper definition metahopperformattingtools.gh (Grasshopper 1.0.7)
# plug-ins: MetaHopper

# ---- group: METAHOPPER TOOLS
# METAHOPPER
# FORMATTING TOOLS
# WIRES VISIBILITY
# SCRIBBLES FONT
# LABEL GROUPS
# SET GROUP PROPERTIES
# OBJECTS PREVIEW
wire_display = ValueList({"Normal": 0, "Faint": 1, "Hidden": 2}, selected="Faint")
font_size = Slider(18, range=0..100)
group_style = ValueList({"None": 0, "Box": 1, "Blob": 2, "Rectangles": 3}, selected="Rectangles")
label_groups = LabelGroups(Run=Toggle(True))
set_scribble_properties = SetScribbleProperties(
    Scribble=["Grasshopper.Kernel.Types.GH_ObjectWrapper", "Grasshopper.Kernel.Types.GH_ObjectWrapper", "Grasshopper.Kernel.Types.GH_ObjectWrapper", "Grasshopper.Kernel.Types.GH_ObjectWrapper", "Grasshopper.Kernel.Types.GH_ObjectWrapper", "Grasshopper.Kernel.Types.GH_ObjectWrapper", "Grasshopper.Kernel.Types.GH_ObjectWrapper", "Grasshopper.Kernel.Types.GH_ObjectWrapper"],
    ScribbleSize=font_size,
    ScribbleFont="Segoe UI")
control_wire_display = ControlWireDisplay(WireDisplay=wire_display)
set_group_properties = SetGroupProperties(
    Group=["Grasshopper.Kernel.Types.GH_ObjectWrapper", "Grasshopper.Kernel.Types.GH_ObjectWrapper"],
    Style=group_style,
    Color=ColourSwatch(SwatchColor=RGBA(103, 216, 219, 160)))
hide_show_object_preview = HideShowObjectPreview(Visible=Toggle(True))
